# Dynamo graph GemetricFunctions.dyn (Dynamo 2.5.2.7915)

code_block = CodeBlock()
# ---------- code_block.designscript (5 lines) ----------
Point.ByCoordinates(0,0,0);
Point.ByCoordinates(2000,0,500);
Point.ByCoordinates(1000,0,0);
Vector.ZAxis();
Vector.XAxis();
# ----------------------------------------
straight_beam_properties = ASPropertiesStraightBeam("Straight Beam Material")
code_block_2 = CodeBlock { "250"; }
byNameAndValue = AdvanceSteel.Nodes.Util.Property.ByNameAndValue(propertyType=straight_beam_properties, propertyValue=code_block_2)
list_create = List.Create(item0=byNameAndValue)
byStartPointEndPoint = AdvanceSteel.Nodes.Beams.StraightBeam.ByStartPointEndPoint(start=code_block.out0, end=code_block.out1, orientation=code_block.out3, additionalBeamParameters=list_create)
code_block_3 = CodeBlock { 0; }
code_block_4 = CodeBlock { DesignScript.Plane.ByOriginNormal(Point.ByCoordinates(1000,0,0),Vector.XAxis()); }
cutElementByPlane = AdvanceSteel.Nodes.Util.Geometry.CutElementByPlane(steelObject=byStartPointEndPoint, bodyResultion=code_block_3, intersectionPlane=code_block_4)
getPropertyByElement = AdvanceSteel.Nodes.Util.Property.GetPropertyByElement(steelObject=byStartPointEndPoint, propertyType=straight_beam_properties)
code_block_5 = CodeBlock { Point.ByCoordinates(500,50,0); Point.ByCoordinates(2000,0,1500); 0; }
byStartPointEndPoint_2 = Line.ByStartPointEndPoint(startPoint=code_block_5.out0, endPoint=code_block_5.out1)
intersectElementByLine = AdvanceSteel.Nodes.Util.Geometry.IntersectElementByLine(steelObject=byStartPointEndPoint, bodyResultion=code_block_5.out2, line=byStartPointEndPoint_2)
